# Grasshopper definition assignment-01.gh (Grasshopper 1.0.8)
# plug-ins: RhinoCodePluginGH

# ---- group: Grid
# Assignment-01: Bauhaus
point = Point(Point(-4.273202757, -3.211116645, 0))
x_count = Slider(6, range=1..10)
y_count = Slider(4, range=1..10)
x_space = Slider(2, range=1..10)
y_space = Slider(2, range=1..10)

centers = Python3Script(pt=point, x1=x_count, y1=y_count, x2=x_space, y2=y_space)  # -> out, a
# ---------- centers: Python ----------
# Import function
from cdf import create_grid_centers

# Call function
my_centers = create_grid_centers(
    base_point=pt,
    x_count=x1,
    y_count=y1,
    x_spacing=x2,
    y_spacing=y2
)

# Assign the output
a = my_centers
# ---------- end centers ----------
my_grid = Python3Script(pt=point, x=x_count, y=y_count, x1=x_space, y1=y_space)  # -> out, a
# ---------- my_grid: Python ----------
# Import function
from cdf import create_grid

# Call function
my_grid = create_grid(
    base_point=pt,
    x_count=x,
    y_count=y,
    x_spacing=x1,
    y_spacing=y1)

# Assign the output
a = my_grid
# ---------- end my_grid ----------

# ---- group: Arragement
list_item = ListItem(List=centers.a, Index=Slider(7, range=0..53), Wrap=True)
list_item_2 = ListItem(List=centers.a, Index=Slider(5, range=0..53), Wrap=True)
list_item_3 = ListItem(List=centers.a, Index=Slider(40, range=0..53), Wrap=True)
list_item_4 = ListItem(List=centers.a, Index=Slider(44, range=0..53), Wrap=True)
list_item_5 = ListItem(List=centers.a, Index=Slider(27, range=0..53), Wrap=True)

# ---- group: Geometries
number_slider = Slider(2.3, range=0..10)
cylinder = Python3Script(pt=list_item_5, h=number_slider, r=Slider(0.9, range=0..10))  # -> out, a
# ---------- cylinder: Python ----------
# Import function
from cdf import create_cylinder

# Call function
my_cylinder = create_cylinder(
    base_point=pt,
    height=h,
    radius=r,
    cap=True
)

# Assign the output
a = my_cylinder
# ---------- end cylinder ----------
torus = Python3Script(pt=list_item_5, maj_r=Slider(1.351, range=0..3), min_r=Slider(1.234, range=0..3))  # -> out, a
# ---------- torus: Python ----------
# Import function
from cdf import create_torus

# Call function
my_torus = create_torus(
    base_point=pt,
    major_radius=maj_r,
    minor_radius=min_r
)

# Assign the output
a = my_torus
# ---------- end torus ----------

pipe = Pipe(Curve=my_grid.a, Radius=Slider(0.038, range=0..0.9), Caps=0)

outer_cylinder = Python3Script(pt=list_item_4, h=Slider(2.3, range=0..10), r=Slider(0.9, range=0..10))  # -> out, a; same code as cylinder
inner_cylinder = Python3Script(pt=list_item_4, r=Slider(0.781, range=0..0.9))  # -> out, a; same code as cylinder

pt = Point(list_item_2)
cone = Python3Script(pt=pt, h=Slider(2, range=1..10), r=Slider(1, range=1..10))  # -> out, my_cone; inputs pt: Point3d
# ---------- cone: Python ----------
# import function
from cdf import create_cone

# call function
my_cone = create_cone(base_point=pt, height=h, radius=r)
# ---------- end cone ----------

number_slider_2 = Slider(2, range=1..10)
pt_2 = Point(list_item_3)
number_slider_3 = Slider(2, range=1..10)
cube = Python3Script(pt=pt_2, x=number_slider_3, y=number_slider_2, z=Slider(3, range=1..10))  # -> out, a
# ---------- cube: Python ----------
# Import function
from cdf import create_cube

# Call function
my_cube = create_cube(
    base_point=pt,
    x_size=x,
    y_size=y,
    z_size=z
)

# Assign the output
a = my_cube
# ---------- end cube ----------

point_2 = Point(list_item)
sphere = Python3Script(pt=point_2, r=Slider(1.6, range=0..10))  # -> out, my_sphere; inputs pt: Point3d, r: Double
# ---------- sphere: Python ----------
from cdf import create_sphere

my_sphere = create_sphere(base_point=pt, radius=r)

a = my_sphere
# ---------- end sphere ----------

# ---- group: transformations & operations
expression = Expression(x=[number_slider_3, number_slider_2], Expression="-x/2")
move_brep = Python3Script(brep=cube.a, x=expression, y=expression, z=Slider(-0.945, range=-9..9))  # -> out, a
# ---------- move_brep: Python ----------
# Import function
from cdf import move_brep

# Call function
my_moved_brep = move_brep(
    brep=brep,
    move_x=x,
    move_y=y,
    move_z=z
)

# Assign the output
a = my_moved_brep
# ---------- end move_brep ----------

rotate_brep = Python3Script(brep=cone.my_cone, x=Slider(180, range=0..180), y=Slider(0, range=0..180))  # -> out, a
# ---------- rotate_brep: Python ----------
# Import function
from cdf import rotate_brep

# Call function
my_rotated_brep = rotate_brep(
    brep=brep,
    angle_x=x,
    angle_y=y,
    center=c
)

# Assign the output
a = my_rotated_brep
# ---------- end rotate_brep ----------

expression_2 = Expression(x=number_slider, Expression="x/2")
move_brep_2 = Python3Script(brep=torus.a, z=expression_2)  # -> out, a; same code as move_brep

boolean_difference = Python3Script(a=outer_cylinder.a, b=inner_cylinder.a)  # -> out, a
# ---------- boolean_difference: Python ----------
from cdf import boolean_difference

my_difference = boolean_difference(brep_a=a, brep_b=b)

a = my_difference
# ---------- end boolean_difference ----------
mirror = Python3Script(brep=rotate_brep.a)  # -> out, a
# ---------- mirror: Python ----------
from cdf import mirror_brep

my_mirrored_brep = mirror_brep(
    brep=brep
)

a = my_mirrored_brep
# ---------- end mirror ----------
brep = Brep(rotate_brep.a)
boolean_difference_2 = Python3Script(a=cylinder.a, b=move_brep_2.a)  # -> out, a; same code as boolean_difference
relay = Relay([mirror.a, brep])

move_brep_3 = Python3Script(brep=boolean_difference.a, x=Slider(0, range=0..0.9), y=Slider(0, range=0..0.9), z=Slider(-1.237, range=-3..3))  # -> out, a; same code as move_brep

# ---- group: Bauhaus Color Palett
preview = CustomPreview(Geometry=[sphere.my_sphere, move_brep.a], Material=ColourSwatch(SwatchColor=RGB(255, 0, 0)))
preview_2 = CustomPreview(Geometry=[boolean_difference_2.a, move_brep_3.a], Material=ColourSwatch(SwatchColor=RGB(255, 255, 0)))
preview_3 = CustomPreview(Geometry=[relay, sphere.my_sphere], Material=ColourSwatch(SwatchColor=RGB(0, 0, 255)))
preview_4 = CustomPreview(Geometry=pipe, Material=ColourSwatch(SwatchColor=RGB(0, 0, 0)))
